# Grasshopper definition 260329_LB sky_dome.gh (Grasshopper 1.0.7)
# Copyright: I'll just come fight ya lawyers are tedious

panel = Panel("D:\01_Projects\2601_Ladybug practice\DEU_HE_Offenbach.Wetterpar.106410_TMYx\DEU_HE_Offenbach.Wetterpar.106410_TMYx.epw")

panel_2 = Panel("https://climate.onebuilding.org/WMO_Region_4_North_and_Central_America/USA_United_States_of_America/FL_Florida/USA_FL_NAS.Jacksonville-Towers.Field.722065_TMY3.zip")
downloadepw = LBDownloadWeather(weather_URL=panel_2)  # -> epw_file, stat_file, ddy_file; plug-in component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
importepw = LBImportEPW(epw_file=panel)  # -> location, dry_bulb_temperature, dew_point_temperature, relative_humidity, wind_speed, wind_direction, direct_normal_rad, diffuse_horizontal_rad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; plug-in component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

analysisperiod = LBAnalysisPeriod(start_month="3", start_day="1", start_hour="0", end_month="3", end_day="31", end_hour="23", timestep="1")  # -> period, hoys, dates; plug-in component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

analysisperiod_2 = LBAnalysisPeriod(start_month="1", start_day="1", start_hour="2", end_month="12", end_day="31", end_hour="12", timestep="6")  # -> period, hoys, dates; plug-in component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

toggle = BooleanToggle(True)
benefitmatrix = LBBenefitSkyMatrix(
    location=importepw.location,
    temperature=importepw.dry_bulb_temperature,
    bal_temp=Slider(15, range=-30..30),
    direct_rad=importepw.direct_normal_rad,
    diffuse_rad=importepw.diffuse_horizontal_rad,
    hoys=analysisperiod.hoys,
    high_density=toggle)  # -> report, sky_mtx; plug-in component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
number_slider = Slider(1, range=0..10)
skymatrix = LBCumulativeSkyMatrix(
    location=importepw.location,
    direct_rad=importepw.direct_normal_rad,
    diffuse_rad=importepw.global_horizontal_rad,
    hoys=analysisperiod.hoys,
    high_density=toggle)  # -> out, sky_mtx; plug-in component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
panel_3 = Panel("Orthographic")
skydome = LBSkyDome(sky_mtx=skymatrix.sky_mtx, center_pt="0,0,0,", scale=number_slider)  # -> out, mesh, compass, legend, title, patch_vecs, patch_values, mesh_values, vis_set; plug-in component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
skydome_2 = LBSkyDome(sky_mtx=benefitmatrix.sky_mtx, center_pt="0,350,0,", scale=number_slider)  # -> out, mesh, compass, legend, title, patch_vecs, patch_values, mesh_values, vis_set; plug-in component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
sunpath = LBSunPath(location=importepw.location, hoys=analysisperiod.hoys, center_pt="0,-350,0,", scale=number_slider)  # -> report, vectors, altitudes, azimuths, hoys, sun_pts, analemma, daily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; plug-in component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
vdis = VectorDisplay(Anchor=sunpath.sun_pts, Vector=sunpath.vectors)
visset = LBPreviewVisualizationSet(vis_set=flatten(skydome.vis_set))  # -> vs; plug-in component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
