# Grasshopper definition 260330_LB Radiation Rose.gh (Grasshopper 1.0.7)
# Copyright: I'll just come fight ya lawyers are tedious

panel = Panel("D:\01_Projects\2601_Ladybug practice\DEU_HE_Offenbach.Wetterpar.106410_TMYx\DEU_HE_Offenbach.Wetterpar.106410_TMYx.epw")

panel_2 = Panel("https://climate.onebuilding.org/WMO_Region_4_North_and_Central_America/USA_United_States_of_America/FL_Florida/USA_FL_NAS.Jacksonville-Towers.Field.722065_TMY3.zip")
downloadepw = LBDownloadWeather(weather_URL=panel_2)  # -> epw_file, stat_file, ddy_file; plug-in component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
importepw = LBImportEPW(epw_file=panel)  # -> location, dry_bulb_temperature, dew_point_temperature, relative_humidity, wind_speed, wind_direction, direct_normal_rad, diffuse_horizontal_rad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; plug-in component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

# ---- group: Winter months
analysisperiod = LBAnalysisPeriod(start_month="11", start_day="1", start_hour="0", end_month="3", end_day="31", end_hour="23", timestep="1")  # -> period, hoys, dates; plug-in component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

# ----
analysisperiod_2 = LBAnalysisPeriod(start_month="4", start_day="1", start_hour="0", end_month="10", end_day="31", end_hour="23", timestep="1")  # -> period, hoys, dates; plug-in component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

skymatrix = LBCumulativeSkyMatrix(
    location=importepw.location,
    direct_rad=importepw.direct_normal_rad,
    diffuse_rad=importepw.diffuse_horizontal_rad,
    hoys=analysisperiod.hoys)  # -> out, sky_mtx; plug-in component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
benefitmatrix = LBBenefitSkyMatrix(
    location=importepw.location,
    temperature=importepw.dry_bulb_temperature,
    direct_rad=importepw.direct_normal_rad,
    diffuse_rad=importepw.diffuse_horizontal_rad,
    hoys=analysisperiod.hoys)  # -> report, sky_mtx; plug-in component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
skymatrix_2 = LBCumulativeSkyMatrix(
    location=importepw.location,
    direct_rad=importepw.direct_normal_rad,
    diffuse_rad=importepw.diffuse_horizontal_rad,
    hoys=analysisperiod_2.hoys)  # -> out, sky_mtx; plug-in component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
benefitmatrix_2 = LBBenefitSkyMatrix(
    location=importepw.location,
    temperature=importepw.dry_bulb_temperature,
    direct_rad=importepw.direct_normal_rad,
    diffuse_rad=importepw.diffuse_horizontal_rad,
    hoys=analysisperiod_2.hoys)  # -> report, sky_mtx; plug-in component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
brep = Brep([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])
srf = Surface([<surface referenced from the Rhino model> x21])
volume = Volume(Geometry=brep)  # -> Volume, Centroid
area = Area(Geometry=srf)  # -> Area, Centroid
debrep = DeconstructBrep(Brep=brep)  # -> Faces, Edges, Vertices

brep_2 = Brep([<brep referenced from the Rhino model> x76])
wires = BrepWireframe(Brep=brep_2, Density=-1)
pt = ConstructPoint(XCoordinate=Slider(0, range=0..100), YCoordinate="500", ZCoordinate=Slider(0, range=0..100))
radrose = LBRadiationRose(sky_mtx=benefitmatrix_2.sky_mtx, context=flatten(brep_2), center_pt=pt, arrow_scale=1, show_comp="true")  # -> out, mesh, compass, orient_lines, legend, title, dir_vecs, dir_values, vis_set; plug-in component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

brep_3 = Brep([<brep referenced from the Rhino model> x76])
wires_2 = BrepWireframe(Brep=brep_3, Density=-1)
pt_2 = ConstructPoint(XCoordinate="0", YCoordinate="1000", ZCoordinate=Slider(0, range=0..100))
radrose_2 = LBRadiationRose(sky_mtx=benefitmatrix.sky_mtx, context=flatten(brep_3), dir_count="36", center_pt=pt_2, arrow_scale=1, show_comp="true")  # -> out, mesh, compass, orient_lines, legend, title, dir_vecs, dir_values, vis_set; plug-in component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

ma = MassAddition(Input=volume.Volume)  # -> Result, PartialResults
ma_2 = MassAddition(Input=area.Area)  # -> Result, PartialResults
panel_3 = Panel(ma.Result)
panel_4 = Panel(ma_2.Result)
division = Division(A=ma_2.Result, B=ma.Result)
panel_5 = Panel(division)
sort = SortList(Keys=radrose.dir_values, ValuesA=radrose.dir_vecs)  # -> Keys, ValuesA
sort_2 = SortList(Keys=radrose.dir_values, ValuesA=radrose.dir_values)  # -> Keys, ValuesA
item = ListItem(List=sort.ValuesA, Index=0, Wrap=True)  # -> Item1, Item
item_2 = ListItem(List=sort_2.ValuesA, Index=0, Wrap=True)  # -> Item1, Item
panel_6 = Panel([item_2.Item, item.Item])
