# Grasshopper definition 260405_radiation_study.gh (Grasshopper 1.0.7)

panel = Panel("D:\01_Projects\2601_Ladybug practice\DEU_HE_Offenbach.Wetterpar.106410_TMYx\DEU_HE_Offenbach.Wetterpar.106410_TMYx.epw")
panel_2 = Panel("D:\01_Projects\2601_Ladybug practice\DEU_HE_Offenbach.Wetterpar.106410_TMYx\DEU_HE_Offenbach.Wetterpar.106410_TMYx.stat")

# ----
# Import Weather Data
# http://climate.onebuilding.org/WMO_Region_4_North_and_Central_America/USA_United_States_of_America/WI_Wisconsin/USA_WI_Madison-Dane.County.Rgnl.AP-Truax.Field.726410_TMY3.zip
downloadepw = LBDownloadWeather()  # -> epw_file, stat_file, ddy_file; plug-in component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
importepw = LBImportEPW(epw_file=panel)  # -> location, dry_bulb_temperature, dew_point_temperature, relative_humidity, wind_speed, wind_direction, direct_normal_rad, diffuse_horizontal_rad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; plug-in component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
importstat = LBImportSTAT(stat_file=panel_2)  # -> location, ashrae_zone, koppen_zone, clear_dir_norm_rad, clear_diff_horiz_rad, ann_heat_dday_996, ann_heat_dday_990, ann_cool_dday_004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; plug-in component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

# ----
# Summer Day
panel_3 = Panel("7")
analysisperiod = LBAnalysisPeriod(start_month=panel_3, start_day="21", start_hour=0, end_month=panel_3, end_day="21")  # -> period, hoys, dates; plug-in component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

# ----
# Summer months
panel_4 = Panel("6")
analysisperiod_2 = LBAnalysisPeriod(start_month=panel_4, start_day="1", start_hour=0, end_month="8", end_day="31")  # -> period, hoys, dates; plug-in component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

# ----
# Winter months
panel_5 = Panel("9")
analysisperiod_3 = LBAnalysisPeriod(start_month=panel_5, start_day="1", start_hour=0, end_month="1", end_day="31")  # -> period, hoys, dates; plug-in component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

# ----
# Annual Radiation
# Benefit/Harm
panel_6 = Panel("20")
benefitmatrix = LBBenefitSkyMatrix(
    north=panel_6,
    location=importepw.location,
    temperature=importepw.dry_bulb_temperature,
    direct_rad=importepw.direct_normal_rad,
    diffuse_rad=importepw.diffuse_horizontal_rad)  # -> report, sky_mtx; plug-in component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

# ----
# Annual Radiation
panel_7 = Panel("20")
skymatrix = LBCumulativeSkyMatrix(
    north=panel_7,
    location=importepw.location,
    direct_rad=importepw.direct_normal_rad,
    diffuse_rad=importepw.diffuse_horizontal_rad)  # -> report, sky_mtx; plug-in component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

# ----
# Specifi time period
# Radiation
panel_8 = Panel("20")
skymatrix_2 = LBCumulativeSkyMatrix(
    north=panel_8,
    location=importstat.location,
    direct_rad=importstat.clear_dir_norm_rad,
    diffuse_rad=importstat.clear_diff_horiz_rad,
    hoys=analysisperiod_3.hoys)  # -> report, sky_mtx; plug-in component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

# ----
# Geometry
# Context
op_4 = Brep([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])
brep = Brep([<brep referenced from the Rhino model> x76])

op_5 = Brep([<brep referenced from the Rhino model> x14])
xmatrix = LBDeconstructMatrix(matrix=flatten(skymatrix.sky_mtx))  # -> values; plug-in component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
panel_9 = Panel(xmatrix)

# ----
# Visualize Sky Matrix
panel_10 = Panel("Orthographic")
skydome = LBSkyDome(sky_mtx=skymatrix.sky_mtx, projection=panel_10)  # -> report, mesh, compass, legend, title, patch_vecs, patch_values, mesh_values, vis_set; plug-in component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

# ----
# Absolute Radiation
number_slider = Slider(0, range=0..100)
brep_2 = Brep(brep)
wires = BrepWireframe(Brep=brep_2, Density=-1)
pt = ConstructPoint(XCoordinate="0", YCoordinate="350", ZCoordinate=number_slider)
radrose = LBRadiationRose(sky_mtx=skymatrix.sky_mtx, context=flatten(brep_2), dir_count="36", center_pt=pt, arrow_scale=1, show_comp="true")  # -> out, mesh, compass, orient_lines, legend, title, dir_vecs, dir_values, vis_set; plug-in component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

# ----
# Benefit Matrix
number_slider_2 = Slider(0, range=0..100)
# Radiation Rose
brep_3 = Brep(brep)
wires_2 = BrepWireframe(Brep=brep_3, Density=-1)
pt_2 = ConstructPoint(XCoordinate="0", YCoordinate="700", ZCoordinate=number_slider_2)
radrose_2 = LBRadiationRose(sky_mtx=benefitmatrix.sky_mtx, context=flatten(brep_3), dir_count="36", center_pt=pt_2, arrow_scale=1, show_comp="true")  # -> out, mesh, compass, orient_lines, legend, title, dir_vecs, dir_values, vis_set; plug-in component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

# ---- group: Run Me!
toggle = BooleanToggle(True)

# ----
# Run Radiation Study
geo = Geometry(brep)
geo_2 = Geometry(op_4)
incidentradiation = LBIncidentRadiation(sky_mtx=skymatrix.sky_mtx, geometry=flatten(geo_2), context=flatten(geo), grid_size="1", offset_dist="0.1", run=toggle)  # -> report, points, results, total, mesh, legend, title, int_mtx; plug-in component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

panel_11 = Panel("true")
meshselector = LBMeshThresholdSelector(values=incidentradiation.results, mesh=incidentradiation.mesh, pct_threshold=Slider(55, range=0..100))  # -> report, total_value, total_area, sub_mesh, outline; plug-in component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
radiation_in_threshold_kwh = Panel(meshselector.total_value)
